# Grasshopper definition Geometric_Impulse.gh (Grasshopper 1.0.7)
# plug-ins: V-Ray For Grasshopper 6, BullAnt

number_slider = Slider(10, range=0..10)
number_slider_2 = Slider(10, range=0..10)
pt = ConstructPoint(XCoordinate=0, YCoordinate=0, ZCoordinate=0)
gggd = GgGeoDome(
    Origin=pt,
    Radius=number_slider,
    Class=Slider(1, range=0..10),
    Bucky=True,
    Freq=Slider(20, range=0..20),
    Lines=False,
    BuckyCL=1)
rotate = Rotate(Geometry=gggd, Angle=degrees(Slider(0, range=0..100)), Plane=PlaneXY(0, 0, 0))  # -> Geometry, Transform
boundary = BoundarySurfaces(Edges=rotate.Geometry)
number_slider_3 = Slider(410, range=0..1000)
md_slider = MDSlider(SliderMode=0, slider_value=Point(0.5, 0.5, 0.5), x_domain=Domain(0, 1), y_domain=Domain(0, 1), z_domain=Domain(0, 1))
evalsrf = EvaluateSurface(Surface=reparameterize(boundary), Point=md_slider)  # -> Point, Normal, UDirection, VDirection, Frame
number_slider_4 = Slider(200, range=0..1000)  # disabled
pt_2 = ConstructPoint(XCoordinate=0, YCoordinate=0, ZCoordinate=0)
number_slider_5 = Slider(205, range=0..1000)  # disabled
deplane = DeconstructPlane(Plane=evalsrf.Frame)  # -> Origin, XAxis, YAxis, ZAxis
scale = Scale(Geometry=boundary, Center=evalsrf.Point, Factor=Slider(0.99, range=0..1))  # -> Geometry, Transform
pdecon = Deconstruct(Point=evalsrf.Point)  # -> XComponent, YComponent, ZComponent
vec2pt = Vector2Pt(PointA=deplane.Origin, PointB=pt_2, Unitize=False)  # -> Vector, Length
pi = Pi(Factor=Slider(1, range=0..10))
amp = Amplitude(Vector=evalsrf.Normal, Amplitude=Slider(0.15, range=0..1))
timeline = VRayTimeline(FramesCount=number_slider_3, RangeStart=number_slider_4, RangeEnd=number_slider_5)  # -> Timeline, CurrentFrame, CurrentFraction
addition = Addition(A=pdecon.XComponent, B=number_slider)
devec = DeconstructVector(Vector=vec2pt.Vector)  # -> XComponent, YComponent, ZComponent
extr = Extrude(Base=scale.Geometry, Direction=amp)
pl = PlaneNormal(Origin=deplane.Origin, ZAxis=vec2pt.Vector)
dom = ConstructDomain(DomainStart=0, DomainEnd=pi)
bnd = Bounds(Numbers=addition)
vec = VectorXYZ(XComponent=0, YComponent=devec.YComponent, ZComponent=devec.ZComponent)  # -> Vector, Length
remap = RemapNumbers(Value=addition, Source=bnd, Target=Domain(0, 1))  # -> Mapped, Clipped
align = AlignPlane(Plane=pl, Direction=vec.Vector)  # -> Plane, Angle
graph = GraphMapper(remap.Mapped, x0=0, x1=1, y0=0, y1=1, container_name="Bezier", cpx=[0, 0.25, 0.75, 1], cpy=[1, 0.25, 0.75, 0])
deplane_2 = DeconstructPlane(Plane=align.Plane)  # -> Origin, XAxis, YAxis, ZAxis
number_slider_6 = Slider(200, range=0..1000)
pi_2 = Pi(Factor=Slider(2, range=0..10))
subtraction = Subtraction(A=number_slider_3, B="1")
dom_2 = ConstructDomain(DomainStart=0, DomainEnd=pi_2)
dom_3 = ConstructDomain(DomainStart=0, DomainEnd=subtraction)
multiplication = Multiplication(A=graph, B=number_slider_6)
pl_2 = ConstructPlane(Origin=deplane_2.Origin, XAxis=deplane_2.XAxis, YAxis=deplane_2.ZAxis)
dom_4 = ConstructDomain(DomainStart=0, DomainEnd=number_slider_6)
int = Integer(multiplication)
c_script = CSharpScript(y=int, x=timeline.CurrentFrame, z=number_slider_6)  # -> out, A; inputs y: Int32, x: Int32, z: Int32
# ---------- c_script: C# ----------
    if(x > y && (x - y) < z)
      A = x - y;
    else if((x-y)>=z)
      A = z;
    else
      A = 0;
# ---------- end c_script ----------
remap_2 = RemapNumbers(Value=timeline.CurrentFrame, Source=dom_3, Target=Domain(0, 1))  # -> Mapped, Clipped
remap_3 = RemapNumbers(Value=c_script.A, Source=dom_4, Target=dom_2)  # -> Mapped, Clipped
pi_3 = Pi(Factor=Slider(4, range=0..10))
multiplication_2 = Multiplication(A=remap_2.Mapped, B=pi_3)
number_slider_7 = Slider(45, range=0..100)
rotate_2 = Rotate(Geometry=extr, Angle=remap_3.Mapped, Plane=pl_2)  # -> Geometry, Transform
cos = Cosine(Value=multiplication_2)
debrep = DeconstructBrep(Brep=rotate_2.Geometry)  # -> Faces, Edges, Vertices
sin = Sine(Value=multiplication_2)
multiplication_3 = Multiplication(A=sin, B=number_slider_7)
multiplication_4 = Multiplication(A=cos, B=number_slider_7)
cull_i = CullIndex(List=debrep.Faces, Indices="0", Wrap=True)
item = ListItem(List=debrep.Faces, Index=0, Wrap=True)
panel = Panel(c_script.A)
join = BrepJoin(Breps=cull_i)  # -> Breps, Closed
brep = Brep(join.Breps)
brep_2 = Brep(item)
number_slider_8 = Slider(0, range=0..100)
panel_2 = Panel("0")
pt_3 = ConstructPoint(XCoordinate=Slider(34, range=0..100), YCoordinate=Slider(32, range=0..100), ZCoordinate=Slider(47, range=0..100))
mtl_simple = VRayMaterialSimple(
    Diffuse=ColourSwatch(SwatchColor=RGB(255, 255, 255)),
    Reflection=RGB(232, 232, 232),
    Glossiness=1,
    IOR=Slider(1.5, range=0..10),
    Opacity=1,
    Emission=RGB(0, 0, 0))
pt_4 = ConstructPoint(XCoordinate=number_slider_7, YCoordinate=number_slider_8, ZCoordinate=number_slider_8)
mtl_simple_2 = VRayMaterialSimple(
    Diffuse=ColourSwatch(SwatchColor=RGB(242, 131, 27)),
    Reflection=RGB(237, 237, 237),
    Glossiness=1,
    IOR=1.3,
    Opacity=1,
    Emission=RGB(0, 0, 0))
pt_5 = ConstructPoint(XCoordinate=Slider(0, range=0..100), YCoordinate=Slider(0, range=0..100), ZCoordinate=Slider(0, range=0..100))
sampler = Sampler(0, Has_Extract_Parameter=False, Has_Manage_Collection=False, OptionsLength=2, Options=["Progressive", "Bucket"])
save_file = OutputImage(
    "D:\Rhino_Grass\Frames\a.jpg",
    File_Picker=1,
    File_Types="Portable Network Graphics (*.png)|*.png|Windows bitmap (*.bmp)|*.bmp|Targa Image (*.tga)|*.tga|Radiance High-Dynamyc Range (*.hdr)|*.hdr|Silicon Graphics (*.sgi; *.rgb; *.rgba)|*.dgi;*.rgb;*.rgba|JPEG image (*.jpg; *.jpeg)|*.jpg;*.jpeg|OpenEXR image (*.exr)|*.exr|SoftImage PICT (*.pic)|*.pic|Tagged image (*.tif; *.tiff)|*.tif;*.tiff|V-Ray Raw Image (*.vrimg)|*.vrimg",
    Has_Extract_Parameter=False,
    Has_Manage_Collection=True,
    Has_Multiple_Files_Menu=False,
    Has_Picker_File_Menu=False,
    Multiple_Files=False)
quality = Quality(
    3,
    Has_Extract_Parameter=False,
    Has_Manage_Collection=False,
    OptionsLength=5,
    Options=["Draft", "Low", "Medium", "High", "Very High"])
engine = Engine(0, Has_Extract_Parameter=False, Has_Manage_Collection=False, OptionsLength=2, Options=["CPU", "GPU"])
mode = Mode(1, Has_Extract_Parameter=False, Has_Manage_Collection=False, OptionsLength=2, Options=["Interactive", "Production"])
vgeo = VRayGeometry(Geo=brep, Material=mtl_simple)
vgeo_2 = VRayGeometry(Geo=brep_2, Material=mtl_simple_2)
light_rectangle = VRayLightRectangle(
    On=True,
    Position=pt_3,
    Target=Point(0, 0, 0),
    Color=RGB(255, 255, 255),
    Intensity=Slider(1.4, range=0..10),
    Invisible=True,
    Size=Slider(69, range=0..100))
camera = VRayCamera(
    Position=pt_4,
    Target=pt_5,
    FOV=Slider(40, range=0..100),
    PhysicalExposureOn=False,
    FNumber=8,
    ShutterSpeed1S=100,
    FilmSensitivity=625)  # -> Camera, Angle
rig_dome = VRayLightRigDome(
    LightOn=True,
    Visible=True,
    Texture="C:\Program Files\Chaos Group\V-Ray\V-Ray for Rhinoceros\maps\BOX_6 (blured).hdr",
    Intensity=Slider(0.33, range=0..1),
    Rotation=Slider(100, range=0..100),
    BackgroundIntensity=Slider(0.66, range=0..1),
    AdditionalLights=light_rectangle)
render = VRayRender(
    Engine=engine,
    Mode=mode,
    Sampler=sampler,
    Quality=quality,
    OutputImage=save_file,
    OutputResolution=[1000, 1000],
    Camera=camera.Camera,
    LightRig=rig_dome,
    VGeometry=flatten([vgeo_2, vgeo]),
    Timeline=timeline.Timeline)
